# Grasshopper definition wavy_fins_2.gh (Grasshopper 1.0.7)
# plug-ins: ShapeDiverForGrasshopper, Pufferfish, LunchBox, Triceratops, Bifocals

sddp = ShapeDiverDocumentPayload({AbsoluteTolerance=0, AngleTolerance=0, DistanceDisplayPrecision=0, GltfVersion="Gltf2", InputGroups="{}", OutputGroups="{}", RelativeTolerance=0, UnitSystem=0, VersionCreated="1.13.1.0", VersionSaved="1.13.1.0"})
file_path = FilePath("C:\Uni\2024\Term 2\CODE2132\sabri-web-page\web-page\assets\config.json")
read_file = ReadFile(File=file_path, PerLineParse=True)
panel = Panel(read_file)
panel_2 = Panel("""0
-1""")
cull_index = CullIndex(List=panel, Indices=panel_2, Wrap=True)
panel_3 = Panel(cull_index)
text_split = TextSplit(Text=panel_3, Separators=":")
standardmat = MeshStandardMaterial(
    Color=flatten(ColourSwatch(SwatchColor=RGB(180, 193, 204))),
    Opacity=1,
    Roughness=1,
    Metalness=Slider(0.5, range=0..1),
    Emissive=RGB(0, 0, 0),
    EmissiveIntensity=1)
standardmat_2 = MeshStandardMaterial(
    Color=flatten(ColourSwatch(SwatchColor=RGB(128, 119, 111))),
    Opacity=1,
    Roughness=1,
    Metalness=0.5,
    Emissive=RGB(0, 0, 0),
    EmissiveIntensity=1)
standardmat_3 = MeshStandardMaterial(
    Color=flatten(ColourSwatch(SwatchColor=RGB(43, 195, 255))),
    Opacity=Slider(0.55, range=0..1),
    Roughness=1,
    Metalness=Slider(0, range=0..100),
    Emissive=RGB(0, 0, 0),
    EmissiveIntensity=1)
replace_text = ReplaceText(Text=text_split, Find="\"", RecursiveReplace=False)
replace_text_2 = ReplaceText(Text=replace_text, Find=",", RecursiveReplace=False)
replace_text_3 = ReplaceText(Text=replace_text_2, Find=" ", RecursiveReplace=False)  # -> simplify(Result)
panel_4 = Panel(replace_text_3)
list_item = ListItem(List=panel_4, Index="1", Wrap=True)  # -> flatten(Item)

# ---- group: FLOOR HEIGHT
list_item_2 = ListItem(List=list_item, Index=0, Wrap=True)

# ----
unit_z = UnitZ(Factor=list_item_2)

# ---- group: ATTRACTOR PT STRENGTH
list_item_3 = ListItem(List=list_item, Index="4", Wrap=True)

# ---- group: FLOOR NUM
list_item_4 = ListItem(List=list_item, Index="1", Wrap=True)

# ---- group: ATTRACTOR PT SEED
list_item_5 = ListItem(List=list_item, Index="2", Wrap=True)

# ---- group: ATTRACTOR PT STRENGTH
list_item_6 = ListItem(List=list_item, Index="3", Wrap=True)

# ----
# Obtain weather data
panel_5 = Panel("https://climate.onebuilding.org/WMO_Region_5_Southwest_Pacific/AUS_Australia/NSW_New_South_Wales/AUS_NSW_Sydney.Obs-Observatory.Hill.947680_TMYx.2007-2021.zip")
downloadepw = LBDownloadWeather(weather_URL=panel_5)  # -> epw_file, stat_file, ddy_file; plug-in component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
wea = HBWeaFromEPW(epw_file=downloadepw.epw_file)  # -> wea; plug-in component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

runanalysis = Boolean(list_item_3)
floor_height = Slider(1.5, range=0..10)
floor_num = Slider(16, range=0..100)
base_curve = Curve(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)
project = Project(Geometry=base_curve, Plane=PlaneXY(0, 0, 0))  # -> Geometry, Transform
series = Series(Start=0, Step=list_item_2, Count=list_item_4)
unit_z_2 = UnitZ(Factor=series)
move = Move(Geometry=project.Geometry, Motion=unit_z_2)  # -> Geometry, Transform
merge = Merge(Data1=project.Geometry, Data2=move.Geometry)
cull_index_2 = CullIndex(List=merge, Indices="-1", Wrap=True)
boundary_surfaces = BoundarySurfaces(Edges=cull_index_2)  # -> flatten(Surfaces)
extrude = Extrude(Base=boundary_surfaces, Direction=unit_z)

# ---- group: rooms (closed brep)
# Geometry Preparation
geo = Geometry(extrude)
panel_6 = Panel("ScrapeDaSky")
roomsolid = HBRoomFromSolid(geo=flatten(geo), name=panel_6, conditioned=True)  # -> report, rooms; plug-in component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

# ---- group: boolean toggle for run analysis from website
boolean = Boolean(runanalysis)
cull_pattern = CullPattern(List=roomsolid.rooms, CullPattern=boolean)

# ----
move_2 = Move(Geometry=base_curve, Motion=unit_z_2)  # -> Geometry, Transform
number_slider = Slider(200, range=0..1000)
boolean_2 = Boolean(boolean)
divide_curve = DivideCurve(Curve=move_2.Geometry, Count=number_slider, Kinks=False)  # -> Points, Tangents, Parameters
list_length = ListLength(List=move_2.Geometry)
flip_matrix = FlipMatrix(Data=divide_curve.Points)
division = Division(A=list_length, B="2")
polyline = PolyLine(Vertices=flip_matrix, Closed=False)  # -> simplify(Polyline)
list_item_7 = ListItem(List=move_2.Geometry, Index=division, Wrap=True)

number_slider_2 = Slider(15, range=0..100)
area = Area(Geometry=list_item_7)  # -> Area, Centroid
divide_curve_2 = DivideCurve(Curve=list_item_7, Count=number_slider_2, Kinks=False)  # -> Points, Tangents, Parameters
construct_domain = ConstructDomain(DomainStart=Slider(1, range=0..5), DomainEnd=Slider(8, range=0..10))
vector_2pt = Vector2Pt(PointA=area.Centroid, PointB=divide_curve_2.Points, Unitize=False)  # -> Vector, Length
random = Random(Range=construct_domain, Number=number_slider_2, Seed=list_item_5)
amplitude = Amplitude(Vector=vector_2pt.Vector, Amplitude=random)
construct_domain_2 = ConstructDomain(DomainStart=Slider(-8, range=-10..10), DomainEnd=Slider(8, range=-10..10))
move_3 = Move(Geometry=divide_curve_2.Points, Motion=amplitude)  # -> Geometry, Transform
random_2 = Random(Range=construct_domain_2, Number=number_slider_2, Seed=list_item_5)
unit_z_3 = UnitZ(Factor=random_2)
move_4 = Move(Geometry=move_3.Geometry, Motion=unit_z_3)  # -> Geometry, Transform
interpolate = Interpolate(Vertices=move_4.Geometry, Degree=3, Periodic=Toggle(True), KnotStyle=1)  # -> Curve, Length, Domain

boolean_toggle = BooleanToggle(True)
attractor_pt_random_seed = Slider(0, range=0..100)
file_path_2 = FilePath("C:\Uni\2024\Term 2\CODE2132\sabri-web-page\web-page\assets\")
panel_7 = Panel(file_path_2)
divide_curve_3 = DivideCurve(Curve=polyline, Count=floor_num, Kinks=False)  # -> simplify(Points), Tangents, Parameters
area_2 = Area(Geometry=move_2.Geometry)  # -> Area, Centroid
divide_curve_4 = DivideCurve(Curve=interpolate.Curve, Count=number_slider, Kinks=False)  # -> Points, Tangents, Parameters
line = Line(StartPoint=graft(divide_curve_4.Points), EndPoint=simplify(divide_curve_3.Points))  # -> simplify(Line)
attractor_point_strength = Slider(0.12, range=0.1..0.5)
length = Length(Curve=line)
multiplication = Multiplication(A=length, B=list_item_6)
vector_2pt_2 = Vector2Pt(PointA=area_2.Centroid, PointB=divide_curve_3.Points, Unitize=False)  # -> Vector, Length
amplitude_2 = Amplitude(Vector=vector_2pt_2.Vector, Amplitude=multiplication)
move_5 = Move(Geometry=divide_curve_3.Points, Motion=amplitude_2)  # -> Geometry, Transform
polyline_2 = PolyLine(Vertices=move_5.Geometry, Closed=False)  # -> simplify(Polyline)

loft = Loft(Curves=move_2.Geometry, Options={Adjust=False, Closed=False, LoftEnds=0, LoftSimp=0, LoftType=0, Rebuild=10, Refit=0.01})
quad_panels = QuadPanels(Surface=loft, UDivisions=10, VDivisions=Slider(50, range=0..1000))
custom_preview = CustomPreview(Geometry=quad_panels, Material=ColourSwatch(SwatchColor=RGBA(43, 195, 255, 136)))

loft_2 = Loft(
    Curves=[polyline_2, polyline],
    Options={Adjust=False, Closed=False, LoftEnds=0, LoftSimp=0, LoftType=0, Rebuild=10, Refit=0.01})
number_slider_3 = Slider(0.05, range=0..0.1)
offset_surface = OffsetSurface(Surface=loft_2, Distance=number_slider_3, BothSides=number_slider_3, CreateSolid=True)
custom_preview_2 = CustomPreview(Geometry=offset_surface, Material=ColourSwatch(SwatchColor=RGB(148, 148, 148)))

offset_surface_2 = OffsetSurface(Surface=quad_panels, Distance=Slider(0.1, range=0..0.1), Retrim=True)

boundary_surfaces_2 = BoundarySurfaces(Edges=move_2.Geometry)
custom_preview_3 = CustomPreview(Geometry=boundary_surfaces_2, Material=ColourSwatch(SwatchColor=RGB(128, 114, 102)))

unit_z_4 = UnitZ(Factor=Slider(0.5, range=0..1))
mesh_brep = MeshBrep(
    Brep=offset_surface_2,
    Settings={GridMaxCount=0, GridMinCount=16, JaggedSeams=False, MaxEdgeLength=0, MinEdgeLength=0.0001, MinTolerance=0, Refine=True, RefineAngle=0, RelativeTolerance=0.65, SimplePlanes=True, Tolerance=0})
glazing = Mesh(mesh_brep)
mesh = Mesh(Mesh=flatten(glazing), Name="meshStandardWireframe", Material=standardmat_3, DecimalAccuracy=3)

# ---- group: glazing (windows)
glassmod = HBGlassModifier(name="g_material", trans="0.8")  # -> modifier; plug-in component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
geometry = Geometry(glazing)
aperture = HBAperture(geo=geometry, name=panel_6, rad_mod=glassmod)  # -> report, apertures; plug-in component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
addsubface = HBAddSubface(hb_obj=flatten(cull_pattern), sub_faces=flatten(aperture.apertures))  # -> hb_obj; plug-in component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

# ----
mesh_brep_2 = MeshBrep(
    Brep=offset_surface,
    Settings={GridMaxCount=0, GridMinCount=16, JaggedSeams=False, MaxEdgeLength=0, MinEdgeLength=0.0001, MinTolerance=0, Refine=True, RefineAngle=0, RelativeTolerance=0.65, SimplePlanes=True, Tolerance=0})
fins = Mesh(mesh_brep_2)
mesh_2 = Mesh(Mesh=flatten(fins), Name="meshStandardMaterial", Material=standardmat, DecimalAccuracy=3)
extrude_2 = Extrude(Base=boundary_surfaces_2, Direction=unit_z_4)
mesh_brep_3 = MeshBrep(
    Brep=extrude_2,
    Settings={GridMaxCount=0, GridMinCount=16, JaggedSeams=False, MaxEdgeLength=0, MinEdgeLength=0.0001, MinTolerance=0, Refine=True, RefineAngle=0, RelativeTolerance=0.65, SimplePlanes=True, Tolerance=0})
floors = Mesh(mesh_brep_3)
mesh_3 = Mesh(Mesh=flatten(floors), Name="meshStandardWireframe", Material=standardmat_2, DecimalAccuracy=3)
scene = CompileScene(Objects=flatten([mesh_2, mesh, mesh_3]))

# ---- group: shading (surrounding buildings, facade devices)
geometry_2 = Geometry(flatten([fins, floors]))
shade = HBShade(geo=geometry_2)  # -> report, shades; plug-in component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

# ----
# Model + Grids
number_slider_4 = Slider(5, range=0..10)
gridrooms = HBSensorGridFromRooms(rooms=addsubface, grid_size=number_slider_4)  # -> grid, points, mesh; plug-in component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
model = HBModel(
    rooms=flatten(cull_pattern),
    shades=flatten(shade.shades),
    apertures=flatten(aperture.apertures),
    name="sample_model_grid")  # -> report, model; plug-in component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
vizwiref = HBVizualizeWireframe(hb_objs=flatten(model.model))  # -> geo; plug-in component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
assigngridsviews = HBAssignGridsAndViews(model=model.model, grids=flatten(gridrooms.grid))  # -> model; plug-in component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

# ----
# Annual Daylight
annualdaylight = HBAnnualDaylight(model=assigngridsviews, wea=wea, run=boolean_2)  # -> out, results, DA, cDA, UDI, UDI_low, UDI_up; plug-in component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
mjoin = MeshJoin(Meshes=gridrooms.mesh)
data = Data(flatten(annualdaylight.DA))
heatmap = LBSpatialHeatmap(values=data, mesh=mjoin)  # -> mesh, legend, title, colors, legend_par, vis_set; plug-in component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

# ---- group: coloured mesh to json
meshcolorfaces = MeshColorFaces(Mesh=heatmap.mesh, Color=heatmap.colors)
meshvertexcolors = MeshVertexColors(Mesh=meshcolorfaces, Name="analysis mesh", DecimalAccuracy=3)

# ----
boolean_toggle_2 = BooleanToggle(True)
scene_2 = CompileScene(Objects=flatten(meshvertexcolors))
serialize = SerializeObject(Object3d=scene_2, Minify=boolean_toggle_2, Run=boolean_toggle_2)
writetxt = WriteTextFile(Path=file_path_2, FileName="analysis_mesh.json", Data=serialize, Write=boolean_toggle_2)

serialize_2 = SerializeObject(Object3d=scene, Minify=Toggle(True), Run=boolean_toggle)
writetxt_2 = WriteTextFile(Path=file_path_2, FileName="facade.json", Data=serialize_2, Write=boolean_toggle)
